# Grasshopper definition Filter.gh (Grasshopper 1.0.7)

# ---- group: Generate a Gaussian Filter
sigma = Slider(1.6, range=0..5)
genfilter = CSharpScript(size=Slider(9, range=1..15), sigma=sigma)  # -> filter; inputs size: Int32, sigma: Double
# ---------- genfilter: C# ----------
    if (size % 2 == 0) {
      size -= 1;
    }
    if (size < 1) {
      return;
    }
    DataTree<double> result = new DataTree<double>();
    double c = (size - 1) / 2;
    double sum = 0;
    for (int i = 0;i < size;i++) {
      for (int j = 0;j < size;j++) {
        double value = Math.Exp(-((c - i) * (c - i) + (c - j) * (c - j)) / (2 * sigma * sigma)) / (2 * Math.PI * sigma * sigma);
        sum += value;
        result.Add(value,new GH_Path(i));
      }
    }
    for (int i = 0;i < size;i++) {
      for (int j = 0;j < size;j++) {
        result[new GH_Path(i), j] /= sum;
      }
    }
    filter = result;
# ---------- end genfilter ----------

# ----
panel = Panel(genfilter)
